# Grasshopper definition 160407_CityMatrix.gh (Grasshopper 0.9.76)
# plug-ins: Python Interpreter, gHowl, HDTReference, LunchBox

# ---- group: mesh coloring
com_color = ColourSwatch(SwatchColor=RGB(255, 122, 122))
com_gray = ColourSwatch(SwatchColor=RGB(171, 171, 171))
res_color = ColourSwatch(SwatchColor=RGB(251, 255, 122))
mesh = Mesh(<mesh referenced from the Rhino model>)
sidewalk = ColourSwatch(SwatchColor=RGB(107, 107, 107))
bikelane = ColourSwatch(SwatchColor=RGB(47, 153, 49))
res_gray = ColourSwatch(SwatchColor=RGB(227, 227, 227))
parking = ColourSwatch(SwatchColor=RGB(196, 156, 100))
blank = ColourSwatch(SwatchColor=RGB(110, 110, 110))
road = ColourSwatch(SwatchColor=RGB(64, 64, 64))
park = ColourSwatch(SwatchColor=RGB(167, 201, 44))
# 3D City Grid System
text = ColourSwatch(SwatchColor=RGB(0, 0, 0))
mcol = MeshColours(Mesh=mesh, Colours=park)
mesh_2 = Mesh(mcol)

# ---- group: shrink
cell_shrink = Slider(0.95, range=0.75..1)

# ---- group: module meshes lego ref: -1
mesh_3 = Mesh(<mesh referenced from the Rhino model>)

# ---- group: module meshes lego ref: 0 to 5
mesh_4 = Mesh([<mesh referenced from the Rhino model> x6])

# ---- group: colortizer orgin
# CityMatrix
# 
# by Yan "Ryan" Zhang <ryanz@mit.edu>
# for MIT Media Lab, Changing Place Group, CityScope Project
# March.17th.2016
# LEGO Grid System
pt = Point(<point referenced from the Rhino model>)

# ---- group: module meshes lego ref: 6 line bike
mesh_5 = Mesh(<mesh referenced from the Rhino model>)  # disabled

# ---- group: table size ref pt
pt_2 = Point(<point referenced from the Rhino model>)

# ---- group: module meshes lego ref: 6 line car
mesh_6 = Mesh(<mesh referenced from the Rhino model>)  # disabled

# ----
panel = Panel("7002")  # disabled
# PEVs
panel_2 = Panel("127.0.0.1")  # disabled

# ---- group: 3D building site move amount
X = UnitX(Factor="10000")

# ----
swatch = ColourSwatch(SwatchColor=RGB(255, 255, 255))  # disabled
# Traffic Heatmap
# Energy per Capita Heatmap
panel_3 = Panel("C:\Users\RYAN\Documents\GitHub\CityMatrix\Map\PEV_PSG AND PKG_300DPI.png")  # disabled
panel_4 = Panel("0.01")  # disabled
xy = XYPlane(Origin=pt)
dist = Distance(PointA=pt, PointB=pt_2)
mesh_7 = Mesh(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)  # disabled
timer = Timer(TimerInterval=500, Target=division)  # disabled

# ---- group: 6 intersect bike
mesh_8 = Mesh(<mesh referenced from the Rhino model>)  # disabled

# ---- group: 6 intersect car
mesh_9 = Mesh(<mesh referenced from the Rhino model>)  # disabled

# ---- group: udp receiver
udp = UDPReceiver(Address=panel_2, Port=panel, Pattern=0)  # -> Info, Data; disabled

# ----
_4_commed = Slider(12, range=1..25)
_1_resmed = Slider(12, range=1..25)
_3_comhq = Slider(6, range=1..25)
_0_reslux = Slider(5, range=1..25)
_5_rescw = Slider(23, range=1..25)
_2_resmu = Slider(23, range=1..25)

# ---- group: private car / road quator 0s
mesh_10 = Mesh([<mesh referenced from the Rhino model> x4])
pt_3 = Point(<point referenced from the Rhino model>)

# ---- group: base cplane
pln = Plane(xy)

# ----
movetoorgin = MoveToOrgin(G=mesh_3, num=cell_shrink)
movetoorgin_2 = MoveToOrgin(G=mesh_4, num=cell_shrink)
split = TextSplit(Text=udp.Data)  # disabled

# ---- group: PEV center pt
pt_4 = Point(split)  # disabled

# ----
vec2pt = Vector2Pt(PointA=Point(0, 0, 0), PointB=pt_4, Unitize=False)  # -> Vector, Length; disabled
move = Move(Geometry=mesh_7, Motion=vec2pt.Vector)  # -> Geometry, Transform; disabled
vec = Vector(X)
com = ColourSwatch(SwatchColor=RGB(158, 158, 158))
res = ColourSwatch(SwatchColor=RGB(212, 212, 212))
mjoin = MeshJoin(Meshes=move.Geometry)  # disabled

# ---- group: private car / road quator 1s
mesh_11 = Mesh([<mesh referenced from the Rhino model> x4])
pt_5 = Point(<point referenced from the Rhino model>)

# ---- group: private car
scale_nu = ScaleNU(Geometry=mesh_10, Plane=pt_3, ScaleX=cell_shrink, ScaleY=cell_shrink, ScaleZ=1)  # -> Geometry, Transform
scale_nu_2 = ScaleNU(Geometry=mesh_11, Plane=pt_5, ScaleX=cell_shrink, ScaleY=cell_shrink, ScaleZ=1)  # -> Geometry, Transform

# ----
merge = Merge(Data1=_0_reslux, Data2=_1_resmed, Data3=_2_resmu, Data4=_3_comhq, Data5=_4_commed, Data6=_5_rescw)
merge_2 = Merge(Data1=res, Data2=res, Data3=res, Data4=com, Data5=com, Data6=com)

# ---- group: PEVs
previewmat = CustomPreviewMaterials(Geometry=mjoin, DiffuseColor=swatch, Transparency=panel_4, DiffuseBitmap=panel_3)  # disabled

# ---- group: module meshes lego at orgin
mesh_12 = Mesh(movetoorgin_2)

mesh_13 = Mesh(movetoorgin)

# ---- group: PEV / road quator 0s
mesh_14 = Mesh([<mesh referenced from the Rhino model> x4])
pt_6 = Point(<point referenced from the Rhino model>)

# ---- group: color for each type
col = Colour(merge_2)

# ---- group: floor num for each type
int = Integer(merge)

# ---- group: floor height
panel_5 = Panel("3.5")

# ---- group: PEV / road quator 1s
mesh_15 = Mesh([<mesh referenced from the Rhino model> x4])
pt_7 = Point(<point referenced from the Rhino model>)

# ---- group: PEV
scale_nu_3 = ScaleNU(Geometry=mesh_14, Plane=pt_6, ScaleX=cell_shrink, ScaleY=cell_shrink, ScaleZ=1)  # -> Geometry, Transform
scale_nu_4 = ScaleNU(Geometry=mesh_15, Plane=pt_7, ScaleX=cell_shrink, ScaleY=cell_shrink, ScaleZ=1)  # -> Geometry, Transform

# ----
multiplication = Multiplication(A=int, B=panel_5)

# ---- group: base height
panel_6 = Panel("5.0")

# ---- group: building height for each type
num = Number(multiplication)

# ---- group: translate example
pt_8 = Point(Point(-15, -8, 0))  # disabled
python = PythonScript(point=pt_8)  # -> out, output; inputs point: Point3d; disabled
# ---------- python: Python ----------
import Rhino

transform = Rhino.Geometry.Transform.Translation(0,0,5)
point.Transform(transform)

output = point
# ---------- end python ----------

# ----
panel_7 = Panel(num)
panel_8 = Panel("216 Pearl St. Cambridge")
number_slider = Slider(10, range=10..100)
panel_9 = Panel("C:\Users\RYAN\Documents\GitHub\CityMatrix\Data\colortizer_data_rhino_02_YZ.txt")
panel_10 = Panel("C:\Users\RYAN\Documents\GitHub\CityMatrix\Data\colortizer_data_sample.txt")
# Parsing Colortizer Data (CityMatrix 16x16)
panel_11 = Panel("C:\Users\RYAN\Documents\GitHub\CityMatrix\Data\colortizer_data.txt")

# ---- group: meshes lego ref: parking
mesh_16 = Mesh(<mesh referenced from the Rhino model>)

# ----
panel_12 = Panel("C:\Users\RYAN\Documents\GitHub\CityMatrix\Data\colortizer_data_rhino_01_YZ.txt")

# ---- group: meshes lego ref: park
mesh_17 = Mesh(<mesh referenced from the Rhino model>)

# ----
Z = UnitZ(Factor=number_slider)
msphereex = MeshSphereEx(Base=Z, Radius=number_slider, Count=Slider(5, range=0..10))
Z_2 = UnitZ(Factor=Slider(6, range=0..10))
movetoorgin_3 = MoveToOrgin(G=mesh_16, num=cell_shrink)
movetoorgin_4 = MoveToOrgin(G=mesh_17, num=cell_shrink)
move_2 = Move(Geometry=msphereex, Motion=Z_2)  # -> Geometry, Transform

# ---- group: udp receiver
udp_2 = UDPReceiver(Address="127.0.0.1", Port="7001", Pattern=0)  # -> Info, Data

# ----
mcol_2 = MeshColours(Mesh=move_2.Geometry, Colours=park)
tree_scale = Slider(0.78, range=0.5..2)
split_2 = TextSplit(Text=udp_2.Data)

# ---- group: module meshes lego at orgin
mesh_18 = Mesh(movetoorgin_3)

# ---- group: reading txt
file = ReadFile(File=panel_9, PerLineParse=True)

# ---- group: module meshes lego at orgin
mesh_19 = Mesh(movetoorgin_4)

# ---- group: meshes 3D ref: Tree
mesh_20 = Mesh(mcol_2)

# ---- group: overwrite toggle 1 - trans mode
transportation_mode = BooleanToggle(False)

# ---- group: toggle1
bool = Boolean(transportation_mode)

bool_2 = Boolean(bool)

# ----
filter = StreamFilter(Gate=bool_2, Stream0=scale_nu.Geometry, Stream1=scale_nu_3.Geometry)
filter_2 = StreamFilter(Gate=bool_2, Stream0=scale_nu_2.Geometry, Stream1=scale_nu_4.Geometry)
mesh_21 = Mesh(filter_2)
mesh_22 = Mesh(filter)
filter_3 = StreamFilter(Gate=bool_2, Stream0=pt_3, Stream1=pt_6)
filter_4 = StreamFilter(Gate=bool_2, Stream0=pt_5, Stream1=pt_7)
pt_9 = Point(filter_4)
pt_10 = Point(filter_3)

# ---- group: 3D building site move amount
vec_2 = Vector(X)

# ----
tree = Slider(1.19, range=0..5)

# ---- group: colortizer data
txt = Text(file)

# ----
panel_13 = Panel(txt)

# ---- group: parking cell #
parking_cell = Slider(38, range=0..50)

# ---- group: total parking cell number
# Parking & Park
int_2 = Integer(parking_cell)

# ----
split_3 = SplitList(List=txt, Index=9)  # -> ListA, ListB
multiplication_2 = Multiplication(A="3", B=tree)
multiplication_3 = Multiplication(A="3", B=tree)
dom = ConstructDomain(DomainStart=multiplication_2, DomainEnd=multiplication_3)
pshift = ShiftPaths(Data=split_3.ListB, Offset=-1)
pshift_2 = ShiftPaths(Data=split_3.ListA, Offset=-1)

# ---- group: park cell #
park_cell = Slider(14, range=0..50)

# ---- group: total park cell number
int_3 = Integer(park_cell)

# ----
item = ListItem(List=pshift_2, Index=4, Wrap=False)
item_2 = ListItem(List=pshift_2, Index=2, Wrap=False)
item_3 = ListItem(List=pshift_2, Index=3, Wrap=False)
item_4 = ListItem(List=pshift_2, Index=5, Wrap=False)
item_5 = ListItem(List=pshift_2, Index=6, Wrap=False)
item_6 = ListItem(List=pshift_2, Index=7, Wrap=False)
item_7 = ListItem(List=pshift_2, Index=1, Wrap=False)
item_8 = ListItem(List=pshift_2, Index=0, Wrap=False)
item_9 = ListItem(List=pshift_2, Index=8, Wrap=False)
split_4 = TextSplit(Text=item, Separators="\t")
split_5 = TextSplit(Text=item_2, Separators="\t")
split_6 = TextSplit(Text=item_3, Separators="\t")
split_7 = TextSplit(Text=item_4, Separators="\t")
split_8 = TextSplit(Text=item_5, Separators="\t")
split_9 = TextSplit(Text=item_6, Separators="\t")
split_10 = TextSplit(Text=item_7, Separators="\t")
split_11 = TextSplit(Text=item_8, Separators="\t")
split_12 = TextSplit(Text=item_9, Separators="\t")
pshift_3 = ShiftPaths(Data=split_4, Offset=1)
pshift_4 = ShiftPaths(Data=split_5, Offset=1)
pshift_5 = ShiftPaths(Data=split_6, Offset=1)
pshift_6 = ShiftPaths(Data=split_7, Offset=1)
pshift_7 = ShiftPaths(Data=split_8, Offset=1)
pshift_8 = ShiftPaths(Data=split_9, Offset=1)
pshift_9 = ShiftPaths(Data=split_10, Offset=1)
pshift_10 = ShiftPaths(Data=split_11, Offset=1)
pshift_11 = ShiftPaths(Data=split_12, Offset=1)
item_10 = ListItem(List=pshift_3, Index=0, Wrap=False)
item_11 = ListItem(List=pshift_4, Index=0, Wrap=False)
item_12 = ListItem(List=pshift_5, Index=0, Wrap=False)
item_13 = ListItem(List=pshift_6, Index=0, Wrap=False)
item_14 = ListItem(List=pshift_7, Index=0, Wrap=False)
item_15 = ListItem(List=pshift_8, Index=0, Wrap=False)
item_16 = ListItem(List=pshift_9, Index=0, Wrap=False)
item_17 = ListItem(List=pshift_10, Index=0, Wrap=False)
item_18 = ListItem(List=pshift_11, Index=0, Wrap=False)
txt_2 = Text(item_10)
txt_3 = Text(item_11)
txt_4 = Text(item_12)
txt_5 = Text(item_13)
txt_6 = Text(item_14)
txt_7 = Text(item_15)
txt_8 = Text(item_16)
txt_9 = Text(item_17)
txt_10 = Text(item_18)
panel_14 = Panel(txt_2)
panel_15 = Panel(txt_3)
panel_16 = Panel(txt_4)
panel_17 = Panel(txt_5)
panel_18 = Panel(txt_6)
panel_19 = Panel(txt_7)
panel_20 = Panel(txt_8)
panel_21 = Panel(txt_9)
panel_22 = Panel(txt_10)
item_19 = ListItem(List=pshift_3, Index=1, Wrap=False)

# ---- group: dockRotation
int_4 = Integer(item_19)

int_5 = Integer(item_19)

# ----
item_20 = ListItem(List=pshift_4, Index=1, Wrap=False)
item_21 = ListItem(List=pshift_5, Index=1, Wrap=False)

# ---- group: dockID
int_6 = Integer(item_21)

int_7 = Integer(item_21)

# ----
item_22 = ListItem(List=pshift_6, Index=1, Wrap=False)

# ---- group: slider1
num_2 = Number(item_22)

num_3 = Number(item_22)

# ----
item_23 = ListItem(List=pshift_7, Index=1, Wrap=False)

# ---- group: toggle1
bool_3 = Boolean(item_23)

bool_4 = Boolean(item_23)

# ----
panel_23 = Panel(bool_4)
item_24 = ListItem(List=pshift_8, Index=1, Wrap=False)

# ---- group: toggle2
bool_5 = Boolean(item_24)

bool_6 = Boolean(item_24)

# ----
item_25 = ListItem(List=pshift_9, Index=1, Wrap=False)

# ---- group: gridExtent_x
int_8 = Integer(item_25)

int_9 = Integer(item_25)

# ----
division = Division(A=dist, B=int_8)

# ---- group: cell size
num_4 = Number(division)

num_5 = Number(division)

# ----
division_2 = Division(A=num_5, B=2)
multiplication_4 = Multiplication(A=division_2, B=Slider(0.95, range=0..1))
neg = Negative(Value=multiplication_4)
dom_2 = ConstructDomain(DomainStart=neg, DomainEnd=multiplication_4)

# ---- group: gridExtent_x
# Dashboard
int_10 = Integer(item_25)

# ---- group: cell size
num_6 = Number(division)

# ----
division_3 = Division(A=num_6, B=2.5)
neg_2 = Negative(Value=division_3)
dom_3 = ConstructDomain(DomainStart=neg_2, DomainEnd=division_3)
item_26 = ListItem(List=pshift_10, Index=1, Wrap=False)
item_27 = ListItem(List=pshift_11, Index=1, Wrap=False)

# ---- group: toggle2
bool_7 = Boolean(item_27)

# Human Interaction
bool_8 = Boolean(item_27)

# ---- group: dockRotation
int_11 = Integer(item_19)

# ---- group: IDMax
int_12 = Integer(item_20)

# ---- group: dockID
int_13 = Integer(item_21)

# ---- group: slider1
num_7 = Number(item_22)

# ---- group: toggle1
bool_9 = Boolean(item_23)

# ---- group: toggle2
bool_10 = Boolean(item_24)

# ---- group: gridExtent_x
int_14 = Integer(item_25)

# ---- group: gridIndex
int_15 = Integer(item_26)

# ---- group: toggle2
bool_11 = Boolean(item_27)

# ----
panel_24 = Panel(int_11)
panel_25 = Panel(int_12)
panel_26 = Panel(int_13)
panel_27 = Panel(num_7)
panel_28 = Panel(bool_9)
panel_29 = Panel(bool_10)
panel_30 = Panel(int_14)
panel_31 = Panel(int_15)
panel_32 = Panel(bool_11)
item_28 = ListItem(List=pshift_9, Index=2, Wrap=False)

# ---- group: gridExtent_y
int_16 = Integer(item_28)

int_17 = Integer(item_28)

int_18 = Integer(item_28)

int_19 = Integer(item_28)

# ----
panel_33 = Panel(int_19)
multiplication_5 = Multiplication(A=int_14, B=int_19)
split_13 = SplitList(List=pshift, Index=multiplication_5)  # -> ListA, ListB
pshift_12 = ShiftPaths(Data=split_13.ListA, Offset=-1)
split_14 = TextSplit(Text=pshift_12, Separators="\t")
pshift_13 = ShiftPaths(Data=split_14, Offset=1)

# ---- group: all data
int_20 = Integer(pshift_13)

# ----
panel_34 = Panel(int_20)  # disabled
item_29 = ListItem(List=int_20, Index="3", Wrap=False)
item_30 = ListItem(List=int_20, Index="0", Wrap=False)
item_31 = ListItem(List=int_20, Index="1", Wrap=False)
item_32 = ListItem(List=int_20, Index="2", Wrap=False)
pshift_14 = ShiftPaths(Data=item_30, Offset=-1)
pshift_15 = ShiftPaths(Data=item_31, Offset=-1)
pshift_16 = ShiftPaths(Data=item_32, Offset=-1)
pshift_17 = ShiftPaths(Data=item_29, Offset=-1)

# ---- group: x
int_21 = Integer(pshift_15)

int_22 = Integer(int_21)

int_23 = Integer(int_21)

int_24 = Integer(int_21)

# ---- group: module id
int_25 = Integer(pshift_14)

int_26 = Integer(int_25)

int_27 = Integer(int_25)

# ----
larger = LargerThan(FirstNumber=int_26, SecondNumber="0")  # -> LargerThan, OrEqualTo
smaller = SmallerThan(FirstNumber=int_26, SecondNumber="5")  # -> SmallerThan, OrEqualTo
and = GateAnd(A=larger.OrEqualTo, B=smaller.OrEqualTo)

# ---- group: is building or not
bool_12 = Boolean(and)

# ----
dispatch = Dispatch(List=int_26, DispatchPattern=bool_12)  # -> ListA, ListB

# ---- group: building id
int_28 = Integer(dispatch.ListA)

# ----
larger_2 = LargerThan(FirstNumber=int_27, SecondNumber="0")  # -> LargerThan, OrEqualTo
smaller_2 = SmallerThan(FirstNumber=int_27, SecondNumber="5")  # -> SmallerThan, OrEqualTo
item_33 = ListItem(List=col, Index=graft(int_28), Wrap=False)
and_2 = GateAnd(A=larger_2.OrEqualTo, B=smaller_2.OrEqualTo)
pshift_18 = ShiftPaths(Data=item_33, Offset=-1)
dispatch_2 = Dispatch(List=int_27, DispatchPattern=and_2)  # -> ListA, ListB
smaller_3 = SmallerThan(FirstNumber=int_27, SecondNumber="0")  # -> SmallerThan, OrEqualTo
item_34 = ListItem(List=mesh_12, Index=graft(dispatch_2.ListA), Wrap=False)

# ---- group: color for each building
col_2 = Colour(pshift_18)

# ----
item_35 = ListItem(List=panel_7, Index=graft(int_28), Wrap=False)
pshift_19 = ShiftPaths(Data=item_34, Offset=-1)
pshift_20 = ShiftPaths(Data=item_35, Offset=-1)

# ---- group: building height of each building
num_8 = Number(pshift_20)

# ----
addition = Addition(A=num_8, B=panel_6)
dom_4 = ConstructDomain(DomainStart=0, DomainEnd=addition)

# ---- group: module id
int_29 = Integer(int_25)

# ---- group: y
int_30 = Integer(pshift_16)

int_31 = Integer(int_30)

int_32 = Integer(int_30)

# ---- group: road check matrix
python_2 = PythonScript(xe=int_8, ye=int_16, x=int_23, y=int_32, id=int_27)  # -> out, m; inputs x: list, y: list, id: list
# ---------- python_2: Python ----------
"""
CityMatrix

written by "Ryan" Yan Zhang <ryanz@mit.edu>
for MIT Media Lab, Changing Place Group
April.6th.2016
"""

import rhinoscriptsyntax as rs

m = [[-1 for n in range(xe)] for n in range(ye)]

for n in range(len(id)):
    if id[n] == 7:
        m[y[n]][x[n]] = 6
    else:
        m[y[n]][x[n]] = id[n]

for n in range(ye):
    print m[n]
# ---------- end python_2 ----------

# ----
modulecenter = ModuleCenter(pt=pt, num=num_4, int_2=int_23, int=int_32)  # -> pt_5, transform_2

# ---- group: road check list
python_3 = PythonScript(xe=int_8, ye=int_16, x=int_23, y=int_32, id=int_27, m=python_2.m)  # -> out, rdType; inputs x: list, y: list, id: list, m: list
# ---------- python_3: Python ----------
"""
CityMatrix

written by "Ryan" Yan Zhang <ryanz@mit.edu>
for MIT Media Lab, Changing Place Group
April.6th.2016
"""

import rhinoscriptsyntax as rs

rdType = []

for n in range(len(id)):
    
    code = []
    
    if id[n]==6 or id[n]==7:
        
        # 0: check x, y+1
        if y[n]+1>ye-1:
            code.append(1)
        else:
            if m[y[n]+1][x[n]]==6:
                code.append(1)
            else:
                code.append(0)
        
        # 1: check x+1, y
        if x[n]+1>xe-1:
            code.append(1)
        else:
            if m[y[n]][x[n]+1]==6:
                code.append(1)
            else:
                code.append(0)
        
        # 2: check x, y-1
        if y[n]-1<0:
            code.append(1)
        else:
            if m[y[n]-1][x[n]]==6:
                code.append(1)
            else:
                code.append(0)
        
        # 3: check x-1, y
        if x[n]-1<0:
            code.append(1)
        else:
            if m[y[n]][x[n]-1]==6:
                code.append(1)
            else:
                code.append(0)
    
    else:
        
        code = [0,0,0,0]
    
    print code
    rdType.append(code)
# ---------- end python_3 ----------

# ----
xform = Transform(modulecenter.transform_2)  # disabled

# ---- group: module center
pt_11 = Point(modulecenter.pt_5)

pt_12 = Point(pt_11)

# ----
dispatch_3 = Dispatch(List=pt_12, DispatchPattern=bool_12)  # -> ListA, ListB

# ---- group: road check list
python_4 = PythonScript(pt=pt_11, id=int_27, rdType=python_3.rdType, rdQua0=mesh_22, c0=pt_10, rdQua1=mesh_21, c1=pt_9)  # -> out, allRoadMesh; inputs pt: list, id: list, rdType: list, rdQua0: list, rdQua1: list
# ---------- python_4: Python ----------
"""
CityMatrix

written by "Ryan" Yan Zhang <ryanz@mit.edu>
for MIT Media Lab, Changing Place Group
April.6th.2016
"""

import rhinoscriptsyntax as rs
import Rhino.Geometry as rg

allRoadMesh = []

for n in range(len(id)):
    
    if id[n]==6 or id[n]==7:
        
        for i in range(len(rdType[n])):
            t = rdType[n][i]
            v = rs.PointCoordinates(pt[n])
            if t == 0:
                c = rs.PointCoordinates(c0)
                vx = v[0]-c[0]
                vy = v[1]-c[1]
                new = rs.CopyObject(rdQua0[i],(vx,vy,0.))
            else:
                c = rs.PointCoordinates(c1)
                vx = v[0]-c[0]
                vy = v[1]-c[1]
                new = rs.CopyObject(rdQua1[i],(vx,vy,0.))
            allRoadMesh.append(new)
# ---------- end python_4 ----------

# ---- group: road mesh final!
mesh_23 = Mesh(python_4.allRoadMesh)

# ---- group: building center
pt_13 = Point(dispatch_3.ListA)

# ----
move_3 = Move(Geometry=mesh_23, Motion=vec)  # -> Geometry, Transform
box = DomainBox(Base=pt_13, X=dom_2, Y=dom_2, Z=dom_4)
dispatch_4 = Dispatch(List=pt_11, DispatchPattern=smaller_3.SmallerThan)  # -> ListA, ListB
vec2pt_2 = Vector2Pt(PointA=Point(0, 0, 0), PointB=dispatch_4.ListA, Unitize=False)  # -> Vector, Length
move_4 = Move(Geometry=box, Motion=vec)  # -> Geometry, Transform
dispatch_5 = Dispatch(List=pt_11, DispatchPattern=and_2)  # -> ListA, ListB
move_5 = Move(Geometry=mesh_13, Motion=vec2pt_2.Vector)  # -> Geometry, Transform

# ---- group: building geo
box_2 = Box(move_4.Geometry)

# ---- group: textured buildings
panel_35 = Panel("C:\Users\RYAN\Documents\GitHub\CityMatrix\Map\PEV_PSG AND PKG_300DPI.png")  # disabled
panel_36 = Panel("0.01")  # disabled
swatch_2 = ColourSwatch(SwatchColor=RGB(255, 255, 255))  # disabled
boxmap = BoxMapping(Mesh=box_2, Box=box_2)  # disabled
previewmat_2 = CustomPreviewMaterials(Geometry=boxmap, DiffuseColor=swatch_2, Transparency=panel_36, DiffuseBitmap=panel_35)  # disabled

# ----
vec2pt_3 = Vector2Pt(PointA=Point(0, 0, 0), PointB=dispatch_5.ListA, Unitize=False)  # -> Vector, Length

# ---- group: road mesh final!
mesh_24 = Mesh(python_4.allRoadMesh)

# ---- group: blank
mesh_25 = Mesh(move_5.Geometry)

mesh_26 = Mesh(mesh_25)

# ----
move_6 = Move(Geometry=mesh_26, Motion=vec)  # -> Geometry, Transform

# ---- group: 3D Buldings
preview = CustomPreview(Geometry=box_2, Shader=col_2)

# ---- group: road
mesh_27 = Mesh(move_3.Geometry)

# ---- group: blank
mesh_28 = Mesh(move_6.Geometry)

# ---- group: y
int_33 = Integer(int_30)

# ---- group: blank modules
mesh_29 = Mesh(mesh_25)

# ----
geobottomcenter = GeoBottomCenter_2(geo=mesh_29)
lng = ListLength(List=geobottomcenter)
division_4 = Division(A=int_2, B=lng)
randomsplit = RandomSplitList(MasterList=geobottomcenter, Seed=Slider(32, range=0..100), Split=division_4)  # -> ListA, ListB
lng_2 = ListLength(List=randomsplit.ListA)
division_5 = Division(A=int_3, B=lng_2)
randomsplit_2 = RandomSplitList(MasterList=randomsplit.ListA, Seed=Slider(25, range=0..100), Split=division_5)  # -> ListA, ListB

# ---- group: parking center
pt_14 = Point(randomsplit.ListB)

# ---- group: park center lego
pt_15 = Point(randomsplit_2.ListB)

# ----
move_7 = Move(Geometry=pt_15, Motion=vec_2)  # -> Geometry, Transform

# ---- group: park center 3D
pt_16 = Point(move_7.Geometry)

# ----
planesrf = PlaneSurface(Plane=pt_16, XSize=dom_3, YSize=dom_3)
lng_3 = ListLength(List=pt_16)
random = Random(Range="0.8 to 1.4", Number=lng_3, Seed=Slider(72, range=0..100))
multiplication_6 = Multiplication(A=random, B=tree_scale)
scale = Scale(Geometry=mesh_20, Center=Point(0, 0, 0), Factor=multiplication_6)  # -> Geometry, Transform
random_2 = Random(Range=dom, Number=lng_3, Seed=Slider(17, range=0..100))
random_3 = Random(Range=Domain(0, 1000), Number=lng_3, Seed=Slider(35, range=0..100))
vec2pt_4 = Vector2Pt(PointA=Point(0, 0, 0), PointB=pt_15, Unitize=False)  # -> Vector, Length
vec2pt_5 = Vector2Pt(PointA=Point(0, 0, 0), PointB=pt_14, Unitize=False)  # -> Vector, Length
popgeo = PopulateGeometry(Geometry=flatten(planesrf), Count=flatten(random_2), Seed=flatten(random_3))
move_8 = Move(Geometry=mesh_19, Motion=vec2pt_4.Vector)  # -> Geometry, Transform
move_9 = Move(Geometry=mesh_18, Motion=vec2pt_5.Vector)  # -> Geometry, Transform

# ---- group: tree center
pt_17 = Point(flatten(popgeo))

# ----
vec2pt_6 = Vector2Pt(PointA=Point(0, 0, 0), PointB=pt_17, Unitize=False)  # -> Vector, Length
move_10 = Move(Geometry=scale.Geometry, Motion=vec2pt_6.Vector)  # -> Geometry, Transform

# ---- group: parking lego
mesh_30 = Mesh(move_8.Geometry)

# ----
move_11 = Move(Geometry=mesh_30, Motion=vec_2)  # -> Geometry, Transform

# ---- group: parking 3D
mesh_31 = Mesh(move_11.Geometry)

# ---- group: parking lego
mesh_32 = Mesh(move_9.Geometry)

# ----
move_12 = Move(Geometry=mesh_32, Motion=vec_2)  # -> Geometry, Transform

# ---- group: parking 3D
mesh_33 = Mesh(move_12.Geometry)

# ---- group: trees 3D
mesh_34 = Mesh(move_10.Geometry)

# ----
preview_2 = CustomPreview(Geometry=mesh_34, Shader=ColourSwatch(SwatchColor=RGBA(201, 222, 82, 106)))

# ---- group: rotation
int_34 = Integer(pshift_17)

int_35 = Integer(int_34)

int_36 = Integer(int_34)

# ----
dispatch_6 = Dispatch(List=int_36, DispatchPattern=and_2)  # -> ListA, ListB
rotate = Rotate(Geometry=pshift_19, Angle=degrees(dispatch_6.ListA), Plane=PlaneXY(0, 0, 0))  # -> Geometry, Transform
move_13 = Move(Geometry=rotate.Geometry, Motion=vec2pt_3.Vector)  # -> Geometry, Transform

# ---- group: building lego modules
mesh_35 = Mesh(move_13.Geometry)

# ---- group: rotation
int_37 = Integer(int_34)

# ----
panel_37 = Panel(int_21)  # disabled
panel_38 = Panel(int_30)  # disabled
panel_39 = Panel(int_34)  # disabled
panel_40 = Panel(int_25)  # disabled

# ---- group: total cell #
int_38 = Integer(multiplication_5)

# ----
panel_41 = Panel(int_38)

# ---- group: sticky rotations
python_5 = PythonScript(x=int_34)  # -> out, rotations; inputs x: list; disabled
# ---------- python_5: Python ----------
"""
Realtime Simulator

written by Yan "Ryan" Zhang <ryanz@mit.edu>
for MIT Media Lab, Changing Place Group, CityScope Project
March.7th.2016
"""

import scriptcontext as sc

sc.sticky["rotations"] = x

rotations = sc.sticky["rotations"]
# ---------- end python_5 ----------

# ---- group: sticky y steps
python_6 = PythonScript(x=int_30)  # -> out, ySteps; inputs x: list; disabled
# ---------- python_6: Python ----------
"""
Realtime Simulator

written by Yan "Ryan" Zhang <ryanz@mit.edu>
for MIT Media Lab, Changing Place Group, CityScope Project
March.7th.2016
"""

import scriptcontext as sc

sc.sticky["ySteps"] = x

ySteps = sc.sticky["ySteps"]
# ---------- end python_6 ----------

# ---- group: sticky moduleIDs
python_7 = PythonScript(x=int_25)  # -> out, moduleIDs; inputs x: list; disabled
# ---------- python_7: Python ----------
"""
Realtime Simulator

written by Yan "Ryan" Zhang <ryanz@mit.edu>
for MIT Media Lab, Changing Place Group, CityScope Project
March.7th.2016
"""

import scriptcontext as sc

sc.sticky["moduleIDs"] = x

moduleIDs = sc.sticky["moduleIDs"]
# ---------- end python_7 ----------

# ---- group: sticky x steps
python_8 = PythonScript(x=int_21)  # -> out, xSteps; inputs x: list; disabled
# ---------- python_8: Python ----------
"""
Realtime Simulator

written by Yan "Ryan" Zhang <ryanz@mit.edu>
for MIT Media Lab, Changing Place Group, CityScope Project
March.7th.2016
"""

import scriptcontext as sc

sc.sticky["xSteps"] = x

xSteps = sc.sticky["xSteps"]
# ---------- end python_8 ----------

# ----
panel_42 = Panel(python_5.rotations)  # disabled
panel_43 = Panel(python_5.out)  # disabled
panel_44 = Panel(python_6.ySteps)  # disabled
panel_45 = Panel(python_6.out)  # disabled
panel_46 = Panel(python_8.xSteps)  # disabled
panel_47 = Panel(python_8.out)  # disabled
panel_48 = Panel(python_7.moduleIDs)  # disabled
panel_49 = Panel(python_7.out)  # disabled

# ==== cluster ModuleCenter
pt = ClusterInput()
int = ClusterInput()
num = ClusterInput()
int_2 = ClusterInput()

# ---- group: y
int_3 = Integer(int)

# ---- group: cell size
num_2 = Number(num)

# ---- group: x
int_4 = Integer(int_2)

# ---- group: center
pt_2 = Point(pt)

# ----
pt_3 = ConstructPoint(XCoordinate=0, YCoordinate=0, ZCoordinate=0)  # disabled
addition = Addition(A=int_4, B=0.5)
vec2pt = Vector2Pt(PointA=pt_3, PointB=pt_2, Unitize=False)  # -> Vector, Length; disabled
addition_2 = Addition(A=int_3, B=0.5)
multiplication = Multiplication(A=addition, B=num_2)
lng = ListLength(List=int_4)  # disabled
move = Move(Motion=vec2pt.Vector)  # -> Geometry, Transform; disabled
multiplication_2 = Multiplication(A=addition_2, B=num_2)
X = UnitX(Factor=multiplication)
repeat = RepeatData(Data=move.Transform, Length=lng)  # disabled
neg = Negative(Value=multiplication_2)
move_2 = Move(Geometry=pt_2, Motion=X)  # -> Geometry, Transform
graft = GraftTree(Tree=move_2.Transform, IncludeEmptyLists=True, IncludeNullItems=True)  # disabled
Y = UnitY(Factor=neg)
pshift = ShiftPaths(Data=repeat, Offset=-1)  # disabled
move_3 = Move(Geometry=move_2.Geometry, Motion=Y)  # -> Geometry, Transform
graft_2 = GraftTree(Tree=move_3.Transform, IncludeEmptyLists=True, IncludeNullItems=True)  # disabled
comp = Compound(Transforms=[graft, graft_2])  # disabled
graft_3 = GraftTree(Tree=pshift, IncludeEmptyLists=True, IncludeNullItems=True)  # disabled
comp_2 = Compound(Transforms=[comp, graft_3])  # disabled

# ---- group: module center
pt_4 = Point(move_3.Geometry)

# ----
pshift_2 = ShiftPaths(Data=comp_2, Offset=-1)  # disabled
transform = Transform(pshift_2)  # disabled
pt_5 = ClusterOutput(pt_4)
transform_2 = ClusterOutput(transform)  # disabled

# ==== cluster MoveToOrgin
num = ClusterInput()
G = ClusterInput()
num_2 = Number(num)
geobottomcenter = GeoBottomCenter(geo=G)
vec2pt = Vector2Pt(PointA=geobottomcenter, PointB=Point(0, 0, 0), Unitize=False)  # -> Vector, Length
move = Move(Geometry=G, Motion=vec2pt.Vector)  # -> Geometry, Transform
scale_nu = ScaleNU(Geometry=move.Geometry, Plane=PlaneXY(0, 0, 0), ScaleX=num_2, ScaleY=num_2, ScaleZ=1)  # -> Geometry, Transform
G_2 = ClusterOutput(scale_nu.Geometry)

# ==== cluster GeoBottomCenter_2
geo = ClusterInput()
geo_2 = Geometry(geo)
bbox = BoundingBox(Content=geo_2, Plane=PlaneXY(0, 0, 0))  # -> Box, Box_2
box_corners = BoxCorners(Box=bbox.Box)  # -> CornerA, CornerB, CornerC, CornerD, CornerE, CornerF, CornerG, CornerH
pdecon = Deconstruct(Point=box_corners.CornerA)  # -> XComponent, YComponent, ZComponent
pdecon_2 = Deconstruct(Point=box_corners.CornerC)  # -> XComponent, YComponent, ZComponent
addition = Addition(A=pdecon.XComponent, B=pdecon_2.XComponent)
addition_2 = Addition(A=pdecon.YComponent, B=pdecon_2.YComponent)
division = Division(A=addition, B=2)
division_2 = Division(A=addition_2, B=2)
pt = ConstructPoint(XCoordinate=division, YCoordinate=division_2, ZCoordinate=pdecon.ZComponent)
pshift = ShiftPaths(Data=pt, Offset=-1)
pt_2 = Point(pshift)
pt_3 = ClusterOutput(pt_2)

# ==== cluster GeoBottomCenter
geo = ClusterInput()
geo_2 = Geometry(geo)
bbox = BoundingBox(Content=geo_2, Plane=PlaneXY(0, 0, 0))  # -> Box, Box_2
box_corners = BoxCorners(Box=bbox.Box)  # -> CornerA, CornerB, CornerC, CornerD, CornerE, CornerF, CornerG, CornerH
pdecon = Deconstruct(Point=box_corners.CornerA)  # -> XComponent, YComponent, ZComponent
pdecon_2 = Deconstruct(Point=box_corners.CornerC)  # -> XComponent, YComponent, ZComponent
addition = Addition(A=pdecon.XComponent, B=pdecon_2.XComponent)
addition_2 = Addition(A=pdecon.YComponent, B=pdecon_2.YComponent)
division = Division(A=addition, B=2)
division_2 = Division(A=addition_2, B=2)
pt = ConstructPoint(XCoordinate=division, YCoordinate=division_2, ZCoordinate=pdecon.ZComponent)
pt_2 = Point(pt)
pt_3 = ClusterOutput(pt_2)
